# Dynamo graph stand.dyn (Dynamo 0.9.0.3067)

number = DoubleInput(10)
number_2 = DoubleInput(1.5)
byLengths = Cuboid.ByLengths(width=number, length=number, height=number_2)
origin = Point.Origin()
YAxis = Vector.YAxis()
number_3 = DoubleInput(35)
rotate = Geometry.Rotate(geometry=byLengths, origin=origin, axis=YAxis, degrees=number_3)
ZAxis = Vector.ZAxis()
code_block = CodeBlock { 0..#10..4; }
translate = Geometry.Translate(geometry=rotate, direction=ZAxis, distance=code_block)
number_4 = DoubleInput(3)
byCenterPointRadius = Circle.ByCenterPointRadius(radius=number_4)
number_5 = DoubleInput(3)
regularPolygon = Polygon.RegularPolygon(circle=byCenterPointRadius, numberSides=number_5)
number_6 = DoubleInput(20)
extrude = Curve.Extrude(curve=regularPolygon, distance=number_6)
intersectAll = Geometry.IntersectAll(geometry=translate, others=extrude)
number_7 = DoubleInput(135)
rotate_2 = Geometry.Rotate(geometry=translate, origin=origin, axis=ZAxis, degrees=number_7)
intersectAll_2 = Geometry.IntersectAll(geometry=rotate_2, others=extrude)
